# Grasshopper definition Paviliun-Studio-Tropis-MCP.gh (Grasshopper 1.0.8)

# ---- group: 01. Parameter Slider & Series (0.60 m x 11)
x_fasad_barat_m = Slider(-0.7, range=-1.5..0)
modul_sirip_m = Slider(0.6, range=0.4..1.2)
jumlah_sirip = Slider(11, range=5..16)
series_y = Series(Start=0, Step=modul_sirip_m, Count=jumlah_sirip, rhinomcp_alias="series_y", rhinomcp_graph_id="paviliun_sirip_barat")
titik_fasad = ConstructPoint(
    XCoordinate=x_fasad_barat_m,
    YCoordinate=series_y,
    ZCoordinate=0,
    rhinomcp_alias="pt_west",
    rhinomcp_graph_id="paviliun_sirip_barat")
bidang_dasar = XYPlane(Origin=titik_fasad, rhinomcp_alias="xy_plane", rhinomcp_graph_id="paviliun_sirip_barat")

# ---- group: 02. Profil Penampang Sirip (320 x 60 mm)
lebar_sirip_m = Slider(0.32, range=0.15..0.5)
tebal_sirip_m = Slider(0.06, range=0.03..0.15)
radius_sudut_m = Slider(0, range=0..0.03)
profil_320x60mm = Rectangle(
    Plane=bidang_dasar,
    XSize=lebar_sirip_m,
    YSize=tebal_sirip_m,
    Radius=radius_sudut_m,
    rhinomcp_alias="rect_fin",
    rhinomcp_graph_id="paviliun_sirip_barat")  # -> Rec, Length

# ---- group: 03. Rantai Transformasi Rotate 30 deg
sudut_putar_deg = Slider(30, range=0..75)
radians = Radians(Degrees=sudut_putar_deg, rhinomcp_alias="ang_rad", rhinomcp_graph_id="paviliun_sirip_barat")
rotate_30_deg = Rotate(
    Geometry=profil_320x60mm.Rec,
    Angle=radians,
    Plane=bidang_dasar,
    rhinomcp_alias="rot_fin",
    rhinomcp_graph_id="paviliun_sirip_barat")

# ---- group: 04. Extrude 3.2m & Cap Solid (11 Brep)
tinggi_sirip_m = Slider(3.2, range=2.4..4)
tinggi_z = UnitZ(Factor=tinggi_sirip_m, rhinomcp_alias="vec_z", rhinomcp_graph_id="paviliun_sirip_barat")
extrude_sirip = Extrude(Base=rotate_30_deg, Direction=tinggi_z, rhinomcp_alias="extr_fin", rhinomcp_graph_id="paviliun_sirip_barat")
solid_11_brep = CapHoles(Brep=extrude_sirip, rhinomcp_alias="cap_fin", rhinomcp_graph_id="paviliun_sirip_barat")
